# Grasshopper definition 01_send_from_gh.ghx (Grasshopper 1.0.7)

ghpython_script = GhPythonScript(host="broker.hivemq.com")  # -> transport
# ---------- ghpython_script: Python ----------
from compas_eve import set_default_transport
from compas_eve.mqtt import MqttTransport

transport = MqttTransport(host=host)
set_default_transport(transport)
# ---------- end ghpython_script ----------
control_knob = ControlKnob(Decimals=2, Limit=True, Maximum=135, Minimum=0, Range=135, Value=0)
ghpython_script_2 = GhPythonScript(transport=ghpython_script, value=control_knob)  # -> a
# ---------- ghpython_script_2: Python ----------
import getpass
from compas_eve import Message, Publisher, Topic

topic = Topic("/workshop_ds/values/" + getpass.getuser(), Message)

publisher = Publisher(topic)
publisher.publish(Message(value=value))
# ---------- end ghpython_script_2 ----------
