# Grasshopper definition 02_receive_values.ghx (Grasshopper 1.0.7)

ghpython_script = GhPythonScript(host="broker.hivemq.com")  # -> transport
# ---------- ghpython_script: Python ----------
from compas_eve import set_default_transport
from compas_eve.mqtt import MqttTransport

transport = MqttTransport(host=host)
set_default_transport(transport)
# ---------- end ghpython_script ----------
ghpython_script_2 = GhPythonScript(transport=ghpython_script)  # -> subscriber
# ---------- ghpython_script_2: Python ----------
from scriptcontext import sticky as st
from compas_eve import Subscriber, Topic, Message

class ValueSubscriber(Subscriber):
    def message_received(self, message):
        st["aaa"] = "message"
        st["bbb"] = message
        self.last_value = message.value

topic = Topic("/workshop_ds/sensors/co2/#", Message)
subscriber = ValueSubscriber(topic)
subscriber.subscribe()
# ---------- end ghpython_script_2 ----------
trigger = Trigger(Interval=2000, TimerInterval=2000, Target=ghpython_script_3)
ghpython_script_3 = GhPythonScript(subscriber=ghpython_script_2)  # -> value; disabled
# ---------- ghpython_script_3: Python ----------
value = subscriber.last_value
# ---------- end ghpython_script_3 ----------
data_recorder = DataRecorder(ghpython_script_3, DataLimit=-10, RecordData=True)
quick_graph = QuickGraph(data_recorder, SortOrder=0)
